# Grasshopper definition OrchidShells.gh (Grasshopper 1.0.7)
# plug-ins: Kangaroo2 Components

# ----
# Input
y_dimension = Slider(10, range=0..10)
# Change boundary plate if needed
x_dimension = Slider(3, range=1..3)
self_collision_radius = Slider(0.7, range=0..1)
multiplication = Multiplication(A=10, B=x_dimension)
# OrchidShell Generation
# By Simon Laporte
mplane = MeshPlane(
    Boundary={Plane=PlaneXY(0, 0, 0), Size=Domain2(u=-10..10, v=-10..10)},
    WidthCount=multiplication,
    HeightCount=y_dimension)  # -> Mesh, Area
scale_nu = ScaleNU(Geometry=mplane.Mesh, Plane=PlaneXY(0, 0, 0), ScaleX=x_dimension, ScaleY=1, ScaleZ=1)  # -> Geometry, Transform
demesh = DeconstructMesh(Mesh=scale_nu.Geometry)  # -> Vertices, Faces, Colours, Normals

# ----
# Change boundary anchors if needed
addition = Addition(A=y_dimension, B=1)
# Other Kangaroo obejcts
addition_2 = Addition(A=multiplication, B=1)
series = Series(Start=multiplication, Step=addition_2, Count=addition)
item = ListItem(List=demesh.Vertices, Index=series, Wrap=True)
sc = SphereCollide(Points=demesh.Vertices, Radius=self_collision_radius, Strength=1)
anchor = Anchor(Point=item, Strength=10000)
grab = Grab(On=True, Strength=1, Range=3)

# ----
# Differential Growth Definition
medges = MeshEdges(Mesh=scale_nu.Geometry)  # -> NakedEdges, InteriorEdges, NonManifoldEdges
merge = Merge(Data1=medges.NakedEdges, Data2=medges.InteriorEdges)  # -> flatten(Result)
end = EndPoints(Curve=merge)  # -> Start, End
X = UnitX(Factor=1)
vec2pt = Vector2Pt(PointA=end.Start, PointB=end.End, Unitize=False)  # -> Vector, Length
angle = Angle(VectorA=vec2pt.Vector, VectorB=X)  # -> Angle, Reflex
pi = Pi(Factor=0.25)
larger = LargerThan(FirstNumber=pi, SecondNumber=angle.Angle)  # -> LargerThan, OrEqualTo
smooth = Smooth(M=mplane.Mesh, Strength=1)
number_slider = Slider(10, range=0..10)

# ---- group: Horizontal fibers
cull = CullPattern(List=merge, CullPattern=invert(larger.LargerThan))

# ---- group: Vertical fibers
cull_2 = CullPattern(List=merge, CullPattern=larger.LargerThan)

# ----
len = Length(Curve=cull_2)

curvepoint = PointOnCurve(cull, parameter=0.5)
curvepoint_2 = PointOnCurve(cull_2, parameter=0.5)
pdecon = Deconstruct(Point=curvepoint)  # -> XComponent, YComponent, ZComponent
len_2 = Length(Curve=cull)
pdecon_2 = Deconstruct(Point=curvepoint_2)  # -> XComponent, YComponent, ZComponent
addition_3 = Addition(A=pdecon.XComponent, B=30)
abs = Absolute(Value=addition_3)
abs_2 = Absolute(Value=pdecon_2.YComponent)
sort = SortList(Keys=abs)  # -> reverse(Keys), ValuesA
sort_2 = SortList(Keys=abs_2)  # -> reverse(Keys), ValuesA
item_2 = ListItem(List=sort.Keys, Index=0, Wrap=True)
item_3 = ListItem(List=sort_2.Keys, Index=0, Wrap=True)
# Play around with different funcitons for various results
expression = Expression(x=len, y=abs_2, z=item_3, w=number_slider, Expression="x+(y/z)*w")
expression_2 = Expression(x=len_2, y=abs, z=item_2, w=number_slider, Expression="x+(y/z)*w")
length_line = LengthLine(Line=cull, Length=expression_2, Strength=10)
length_line_2 = LengthLine(Line=cull_2, Strength=10)

# ----
# Simulation
merge_2 = Merge(Data1=sc, Data2=anchor, Data3=length_line, Data4=grab, Data5=smooth, Data6=length_line_2)  # -> flatten(Result)
solver = Solver(GoalObjects=merge_2, Reset=Button(), Threshold=1e-15, Tolerance=0.0001, On=Toggle(False))  # -> I, V, O
clean = CleanTree(RemoveNulls=True, RemoveInvalid=True, RemoveEmpty=False, Tree=solver.O)
line = Line(clean)
